# Grasshopper definition GSD Model.gh (Grasshopper 1.0.7)
# plug-ins: PolyFrameGH Info, Pufferfish

# ----
# 2d geometry
geometry = Geometry([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])
geo = Geometry([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])
geo_2 = Geometry([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])

# ----
# Transform 2d geometry into force polyhedran
number_slider = Slider(100, range=-100..900)
geometry_2 = Geometry(flatten(geometry))
region_union = RegionUnion(Curves=geometry_2)
negative = Negative(Value=number_slider)
area = Area(Geometry=region_union)  # -> Area, Centroid
unit_z = UnitZ(Factor=negative)
unit_z_2 = UnitZ(Factor=expr("-1/16*x", number_slider))
move = Move(Geometry=area.Centroid, Motion=unit_z)  # -> Geometry, Transform
move_2 = Move(Geometry=area.Centroid, Motion=unit_z_2)  # -> Geometry, Transform
circle = Circle(Plane=move_2.Geometry, Radius=expr("10*x", number_slider))
extr = ExtrudePoint(Base=geometry_2, Point=move.Geometry)
split_brep_multiple = SplitBrepMultiple(Brep=extr, Cutters=circle)
cap_holes = CapHoles(Brep=split_brep_multiple)  # -> flatten(Brep)

# ----
# Polyframe
number_slider_2 = Slider(10000, range=0..10000)
pfbuild = PFBuild(Brep=cap_holes, AbsoluteTolerance=0.1, PlanarityTolerance=0.1)  # -> Force, Form
pfperp = PFPerp(PFoam=pfbuild.Form, MaxIteration=number_slider_2, Deviation=0.1, MinimumEdgeLength=Slider(10, range=0..10))  # -> PFoam, Deviation
explode_pfoam = ExplodePFoam(PFoam=pfperp.PFoam)  # -> Vertices, Edges, Faces, Cells
separate_half_edges = SeparateHalfEdges(PFEdge=explode_pfoam.Edges)  # -> Positive, Negative
separate_half_faces = SeparateHalfFaces(PFFace=explode_pfoam.Faces)  # -> Positive, Negative
pfpipe = PFPipe(PFoam=pfperp.PFoam, MinR=-1, MaxR=-1)  # -> Axes, Radius, Color, Pipe, Force

# ----
# ExF Dictionary
inspect_face = InspectFace(Face=separate_half_faces.Positive)  # -> ID, Mesh, External, Area, Plane, Vertices, Edges, Cell, Dual, Pair
dispatch = Dispatch(List=separate_half_faces.Positive, DispatchPattern=inspect_face.External)  # -> ListA, ListB
face_to_brep = FaceToBrep(PFFace=dispatch.ListB)
explode = Explode(Curve=face_to_brep, Recursive=True)  # -> simplify(Segments), Vertices
exf = Panel(explode.Segments)

# ----
# FxE Dictionary
inspect_edge = InspectEdge(Edge=separate_half_edges.Positive)  # -> ID, Line, External, Force, Vertices, Faces, Dual, Pair
dispatch_2 = Dispatch(List=separate_half_edges.Positive, DispatchPattern=inspect_edge.External)  # -> ListA, ListB
inspect_edge_2 = InspectEdge(Edge=dispatch_2.ListB)  # -> ID, Line, External, Force, Vertices, Faces, Dual, Pair
inspect_face_2 = InspectFace(Face=inspect_edge_2.Faces)  # -> ID, Mesh, External, Area, Plane, Vertices, Edges, Cell, Dual, Pair
dispatch_3 = Dispatch(List=inspect_edge_2.Faces, DispatchPattern=inspect_face_2.External)  # -> ListA, simplify(ListB)
face_to_brep_2 = FaceToBrep(PFFace=dispatch_3.ListB)
geo_3 = Geometry(simplify(face_to_brep_2))
fxe = Panel(geo_3)

geo_4 = Geometry(graft(face_to_brep))

geo_5 = Geometry(inspect_edge_2.Line)

# ----
# Categorize edges by length
len = Length(Curve=inspect_edge_2.Line)
sort = SortList(Keys=len)  # -> Keys, ValuesA
item = ListItem(List=sort.Keys, Index=0, Wrap=True)
larger = LargerThan(FirstNumber=len, SecondNumber=expr("2*x", item))  # -> LargerThan, OrEqualTo
dispatch_4 = Dispatch(List=dispatch_2.ListB, DispatchPattern=larger.LargerThan)  # -> ListA, ListB

# ----
# Control Center
offset_from_edge = Slider(2, range=0..10)
max_thickness_2 = Slider(0.6, range=0..1)
min_thickness_2 = Slider(0.2, range=0..1)

inspect_edge_3 = InspectEdge(Edge=dispatch_4.ListB)  # -> ID, Line, External, Force, Vertices, Faces, Dual, Pair
inspect_face_3 = InspectFace(Face=inspect_edge_3.Faces)  # -> ID, Mesh, External, Area, Plane, Vertices, Edges, Cell, Dual, Pair
geo_6 = Geometry(graft(inspect_edge_3.Line))
dispatch_5 = Dispatch(List=inspect_edge_3.Faces, DispatchPattern=inspect_face_3.External)  # -> ListA, simplify(ListB)
sort_2 = SortList(Keys=inspect_edge_3.Force)  # -> flatten(Keys), ValuesA
face_to_brep_3 = FaceToBrep(PFFace=dispatch_5.ListB)
item_2 = ListItem(List=reverse(sort_2.Keys), Index=0, Wrap=True)
item_3 = ListItem(List=sort_2.Keys, Index=0, Wrap=True)
expression = Expression(
    x=graft(inspect_edge_3.Force),
    y=item_3,
    z=item_2,
    u=max_thickness_2,
    v=min_thickness_2,
    Expression="(((x-y)/(z-y))*(u-v))+v")

inspect_edge_4 = InspectEdge(Edge=dispatch_4.ListA)  # -> ID, Line, External, Force, Vertices, Faces, Dual, Pair
inspect_face_4 = InspectFace(Face=inspect_edge_4.Faces)  # -> ID, Mesh, External, Area, Plane, Vertices, Edges, Cell, Dual, Pair
geo_7 = Geometry(graft(inspect_edge_4.Line))
dispatch_6 = Dispatch(List=inspect_edge_4.Faces, DispatchPattern=inspect_face_4.External)  # -> ListA, simplify(ListB)
sort_3 = SortList(Keys=inspect_edge_4.Force)  # -> flatten(Keys), ValuesA
face_to_brep_4 = FaceToBrep(PFFace=dispatch_6.ListB)
item_4 = ListItem(List=reverse(sort_3.Keys), Index=0, Wrap=True)
item_5 = ListItem(List=sort_3.Keys, Index=0, Wrap=True)
expression_2 = Expression(
    x=graft(inspect_edge_4.Force),
    y=item_5,
    z=item_4,
    u=max_thickness_2,
    v=min_thickness_2,
    Expression="(((x-y)/(z-y))*(u-v))+v")

# ----
# Setup
sort_4 = SortList(Keys=inspect_edge_2.Force)  # -> flatten(Keys), ValuesA
item_6 = ListItem(List=reverse(sort_4.Keys), Index=0, Wrap=True)
item_7 = ListItem(List=sort_4.Keys, Index=0, Wrap=True)
geo_8 = Geometry(graft(inspect_edge_2.Line))
expression_3 = Expression(
    x=graft(inspect_edge_2.Force),
    y=item_7,
    z=item_6,
    u=max_thickness_2,
    v=min_thickness_2,
    Expression="(((x-y)/(z-y))*(u-v))+v")
midpt = CurveMiddle(Curve=geo_8)
rot3d = Rotate3D(Geometry=geo_8, Angle=degrees(90), Center=midpt, Axis=face_to_brep_2)  # -> Geometry, Transform
addition = Addition(A=offset_from_edge, B=expression_3)
subtraction = Subtraction(A=offset_from_edge, B=expression_3)

# ----
# Create Frames
offcrv = OffsetCurve(Curve=geo_4, Plane=geo_4, Distance=expr("-x", geo_4), BothSides=0, Kinks=0, CapType=1)
fillet_radius = Slider(0.5, range=0..10)

# ----
# Tab Function for Long Edges (Creates 2 tabs per edge)
midpt_2 = CurveMiddle(Curve=geo_7)
divide = DivideCurve(Curve=geo_7, Count=3, Kinks=False)  # -> Points, Tangents, Parameters

# ----
# Extrusion Vectors
amp = Amplitude(Vector=geo_4, Amplitude=max_thickness_2)
rev = Reverse(Vector=amp)

# ----
# Outer Edge of Frame
amp_2 = Amplitude(Vector=rot3d.Geometry, Amplitude=subtraction)
move_3 = Move(Geometry=geo_8, Motion=amp_2)  # -> flatten(Geometry), Transform
midpt_3 = CurveMiddle(Curve=move_3.Geometry)
srf_cp = SurfaceClosestPoint(Point=midpt_3, Surface=geo_4)  # -> Point, UVPoint, Distance
equals = Equality(FirstNumber=expr("round(x,2)", srf_cp.Distance), SecondNumber=0)  # -> Equality, Inequality
dispatch_7 = Dispatch(List=move_3.Geometry, DispatchPattern=equals.Equality)  # -> ListA, ListB
midpt_4 = CurveMiddle(Curve=dispatch_7.ListA)
scale = Scale(Geometry=dispatch_7.ListA, Center=midpt_4, Factor=2)  # -> Geometry, Transform
surface_split = SurfaceSplit(Surface=geo_4, Curves=scale.Geometry)
area_2 = Area(Geometry=geo_4)  # -> Area, Centroid
incurves = PointInCurves(Point=area_2.Centroid, Curves=surface_split)  # -> Relationship, Index, Point
item_8 = ListItem(List=surface_split, Index=incurves.Index, Wrap=True)
fillet = Fillet(Curve=item_8, Radius=fillet_radius)
extr_2 = Extrude(Base=fillet, Direction=rev)
extr_3 = Extrude(Base=fillet, Direction=amp)
cap = CapHoles(Brep=extr_2)
cap_2 = CapHoles(Brep=extr_3)

# ----
# Inner Edge of Frame
amp_3 = Amplitude(Vector=rot3d.Geometry, Amplitude=addition)
move_4 = Move(Geometry=geo_8, Motion=amp_3)  # -> Geometry, Transform
geo_9 = Geometry(flatten(move_4.Geometry))
midpt_5 = CurveMiddle(Curve=geo_9)
srf_cp_2 = SurfaceClosestPoint(Point=midpt_5, Surface=geo_4)  # -> Point, UVPoint, Distance
equals_2 = Equality(FirstNumber=expr("round(x,1)", srf_cp_2.Distance), SecondNumber=0)  # -> Equality, Inequality
dispatch_8 = Dispatch(List=geo_9, DispatchPattern=equals_2.Equality)  # -> ListA, ListB
midpt_6 = CurveMiddle(Curve=dispatch_8.ListA)
scale_2 = Scale(Geometry=dispatch_8.ListA, Center=midpt_6, Factor=2)  # -> Geometry, Transform
surface_split_2 = SurfaceSplit(Surface=geo_4, Curves=scale_2.Geometry)
area_3 = Area(Geometry=geo_4)  # -> Area, Centroid
incurves_2 = PointInCurves(Point=area_3.Centroid, Curves=surface_split_2)  # -> Relationship, Index, Point
item_9 = ListItem(List=surface_split_2, Index=incurves_2.Index, Wrap=True)
fillet_2 = Fillet(Curve=item_9, Radius=fillet_radius)
extr_4 = Extrude(Base=fillet_2, Direction=rev)
extr_5 = Extrude(Base=fillet_2, Direction=amp)
cap_3 = CapHoles(Brep=extr_4)
cap_4 = CapHoles(Brep=extr_5)

midpt_7 = CurveMiddle(Curve=geo_6)
rot3d_2 = Rotate3D(Geometry=geo_6, Angle=degrees(90), Center=midpt_7, Axis=face_to_brep_3)  # -> Geometry, Transform
# Tab Function for Short Edges (Creates 1 tab per edge)
subtraction_2 = Subtraction(A=offset_from_edge, B=expression)
addition_2 = Addition(A=offset_from_edge, B=expression)
expression_4 = Expression(x=subtraction_2, y=addition_2, Expression="(ABS(x-y))/2")
line = LineSDL(Start=midpt_7, Direction=rot3d_2.Geometry, Length=offset_from_edge)
cluster = Cluster_2(C=geo_6, A=expression_4, relay=line)  # -> T, V
end = EndPoints(Curve=cluster.T)  # -> Start, End
srf_cp_3 = SurfaceClosestPoint(Point=flatten(end.End), Surface=geo_4)  # -> Point, UVPoint, Distance
neg = Negative(Value=expression)
equals_3 = Equality(FirstNumber=expr("round(x,1)", srf_cp_3.Distance), SecondNumber=0)  # -> Equality, Inequality

tstat = TreeStatistics(Tree=face_to_brep_3)  # -> Paths, Length, Count
rev_2 = Reverse(Vector=geo_6)
multiplication = Multiplication(A=simplify(expression), B=graft(tstat.Length))
line_2 = LineSDL(Start=simplify(midpt_7), Direction=simplify([geo_6, rev_2]), Length=simplify(multiplication))
join = JoinCurves(Curves=line_2, Preserve=False)
ext = ExtendCurve(Curve=join, Type=0, Start=expr("x/2", max_thickness_2), End=expr("x/2", max_thickness_2))
midpt_8 = CurveMiddle(Curve=ext)
srf_cp_4 = SurfaceClosestPoint(Point=flatten(midpt_8), Surface=geo_4)  # -> Point, UVPoint, Distance
equals_4 = Equality(FirstNumber=expr("round(x,1)", srf_cp_4.Distance), SecondNumber=0)  # -> Equality, Inequality
dispatch_9 = Dispatch(List=flatten(ext), DispatchPattern=equals_4.Equality)  # -> simplify(ListA), ListB

rot3d_3 = Rotate3D(Geometry=geo_7, Angle=degrees(90), Center=midpt_2, Axis=face_to_brep_4)  # -> Geometry, Transform
item_10 = ListItem(List=divide.Points, Index=1, Wrap=True)
line_3 = LineSDL(Start=item_10, Direction=rot3d_3.Geometry, Length=offset_from_edge)
neg_2 = Negative(Value=expression_2)

subtraction_3 = Subtraction(A=offset_from_edge, B=expression_2)
addition_3 = Addition(A=offset_from_edge, B=expression_2)
expression_5 = Expression(x=subtraction_3, y=addition_3, Expression="(ABS(x-y))/2")
item_11 = ListItem(List=divide.Points, Index=2, Wrap=True)
line_4 = LineSDL(Start=item_11, Direction=rot3d_3.Geometry, Length=offset_from_edge)
cluster_2 = Cluster_2(C=geo_7, A=expression_5, relay=line_4)  # -> T, V
end_2 = EndPoints(Curve=cluster_2.T)  # -> Start, End
srf_cp_5 = SurfaceClosestPoint(Point=flatten(end_2.End), Surface=geo_4)  # -> Point, UVPoint, Distance
neg_3 = Negative(Value=expression_2)
equals_5 = Equality(FirstNumber=expr("round(x,1)", srf_cp_5.Distance), SecondNumber=0)  # -> Equality, Inequality

tstat_2 = TreeStatistics(Tree=face_to_brep_4)  # -> Paths, Length, Count
rev_3 = Reverse(Vector=geo_7)
multiplication_2 = Multiplication(A=simplify(expression_2), B=graft(tstat_2.Length))
line_5 = LineSDL(Start=simplify([item_10, item_11]), Direction=simplify(rev_3), Length=simplify(multiplication_2))
line_6 = LineSDL(Start=simplify([item_10, item_11]), Direction=simplify(geo_7), Length=simplify(multiplication_2))
join_2 = JoinCurves(Curves=[line_5, line_6], Preserve=False)
ext_2 = ExtendCurve(Curve=join_2, Type=0, Start=expr("x/2", max_thickness_2), End=expr("x/2", max_thickness_2))
midpt_9 = CurveMiddle(Curve=ext_2)
srf_cp_6 = SurfaceClosestPoint(Point=flatten(midpt_9), Surface=geo_4)  # -> Point, UVPoint, Distance
equals_6 = Equality(FirstNumber=expr("round(x,1)", srf_cp_6.Distance), SecondNumber=0)  # -> Equality, Inequality
dispatch_10 = Dispatch(List=flatten(ext_2), DispatchPattern=equals_6.Equality)  # -> simplify(ListA), ListB

cluster_3 = Cluster_2(C=geo_7, A=expression_5, relay=line_3)  # -> T, V
end_3 = EndPoints(Curve=cluster_3.T)  # -> Start, End
srf_cp_7 = SurfaceClosestPoint(Point=flatten(end_3.End), Surface=geo_4)  # -> Point, UVPoint, Distance
equals_7 = Equality(FirstNumber=expr("round(x,1)", srf_cp_7.Distance), SecondNumber=0)  # -> Equality, Inequality

# ----
# Conncetion Tabs
panel = Panel("0")

ext_3 = ExtendCurve(Curve=cluster_3.T, Type=0, Start=max_thickness_2, End=panel)
cluster_4 = Cluster(relay_2=ext_3, relay=cluster_3.V)
offcrv_2 = OffsetCurve(Curve=cluster_4, Plane=face_to_brep_4, Distance=expression_2, BothSides=neg_2, Kinks=0, CapType=1)
dispatch_11 = Dispatch(List=flatten(offcrv_2), DispatchPattern=equals_7.Equality)  # -> ListA, ListB
extr_6 = Extrude(Base=dispatch_11.ListA, Direction=rev)
extr_7 = Extrude(Base=dispatch_11.ListA, Direction=amp)
cap_5 = CapHoles(Brep=extr_7)
cap_6 = CapHoles(Brep=extr_6)

ext_4 = ExtendCurve(Curve=cluster_2.T, Type=0, Start=max_thickness_2, End=panel)
cluster_5 = Cluster_4(relay_2=ext_4, relay=cluster_2.V)
offcrv_3 = OffsetCurve(Curve=cluster_5, Plane=face_to_brep_4, Distance=expression_2, BothSides=neg_3, Kinks=0, CapType=1)
dispatch_12 = Dispatch(List=flatten(offcrv_3), DispatchPattern=equals_5.Equality)  # -> ListA, ListB
extr_8 = Extrude(Base=dispatch_12.ListA, Direction=amp)
extr_9 = Extrude(Base=dispatch_12.ListA, Direction=rev)
cap_7 = CapHoles(Brep=extr_8)
cap_8 = CapHoles(Brep=extr_9)

ext_5 = ExtendCurve(Curve=cluster.T, Type=0, Start=max_thickness_2, End=panel)
cluster_6 = Cluster(relay_2=ext_5, relay=cluster.V)
offcrv_4 = OffsetCurve(Curve=cluster_6, Plane=face_to_brep_3, Distance=expression, BothSides=neg, Kinks=0, CapType=1)
dispatch_13 = Dispatch(List=flatten(offcrv_4), DispatchPattern=equals_3.Equality)  # -> ListA, ListB
extr_10 = Extrude(Base=dispatch_13.ListA, Direction=rev)
extr_11 = Extrude(Base=dispatch_13.ListA, Direction=amp)
cap_9 = CapHoles(Brep=extr_11)
cap_10 = CapHoles(Brep=extr_10)

merge = Merge(Data1=cap_8, Data2=cap_10, Data3=cap_6)
merge_2 = Merge(Data1=cap_7, Data2=cap_9, Data3=cap_5)
clean = CleanTree(RemoveNulls=True, RemoveInvalid=True, RemoveEmpty=False, Tree=merge_2)  # -> simplify(Tree)
clean_2 = CleanTree(RemoveNulls=True, RemoveInvalid=True, RemoveEmpty=False, Tree=merge)  # -> simplify(Tree)

# ----
# Join Edges with Tabs
sdiff = SolidDifference(BrepsA=cap_2, BrepsB=cap_4)  # -> simplify(Result)
sdiff_2 = SolidDifference(BrepsA=cap, BrepsB=cap_3)  # -> simplify(Result)
sunion = SolidUnion(Breps=[sdiff, clean])
sunion_2 = SolidUnion(Breps=[sdiff_2, clean_2])

# ----
# Drill Holes for Bolts
merge_3 = Merge(Data1=dispatch_10.ListA, Data2=dispatch_9.ListA)  # disabled
pipe = Pipe(Curve=merge_3, Radius=expr("x/4", max_thickness_2), Caps=1)  # disabled
trim = TrimTree(Tree=pipe, Depth=1)  # -> simplify(Tree); disabled
sdiff_3 = SolidDifference(BrepsA=sunion_2, BrepsB=trim)  # disabled
sdiff_4 = SolidDifference(BrepsA=sunion, BrepsB=trim)  # disabled

# ----
# Cutting Function
cluster_7 = Cluster_3(relay_3=amp, relay_2=rev, relay=geo_4)  # -> simplify(E), simplify(E_2); disabled
splitmul = SplitBrepMultiple(Brep=sdiff_4, Cutters=cluster_7.E)  # disabled
splitmul_2 = SplitBrepMultiple(Brep=sdiff_3, Cutters=cluster_7.E_2)  # disabled
merge_4 = Merge(Data1=splitmul, Data2=splitmul_2)  # disabled
cap_11 = CapHoles(Brep=merge_4)  # disabled
clean_3 = CleanTree(RemoveNulls=True, RemoveInvalid=True, RemoveEmpty=False, Tree=cap_11)  # disabled

# ----
# Get Bolts
geo_10 = Geometry(flatten(pipe))  # disabled
volume = Volume(Geometry=geo_10)  # -> Volume, Centroid; disabled
cset = CreateSet(List=volume.Centroid)  # -> Set, Map; disabled
mindex = MemberIndex(Set=volume.Centroid, Member=cset.Set)  # -> Index, Count; disabled
item_12 = ListItem(List=mindex.Index, Index=0, Wrap=True)  # disabled
item_13 = ListItem(List=geo_10, Index=item_12, Wrap=True)  # disabled

merge_5 = Merge(Data1=item_13, Data2=clean_3)  # disabled

# ==== cluster Cluster
relay = ClusterInput()
relay_2 = ClusterInput()
tstat = TreeStatistics(Tree=relay_2)  # -> Paths, Length, Count
equals = Equality(FirstNumber=tstat.Length, SecondNumber=2)  # -> Equality, Inequality
dispatch = Dispatch(List=tstat.Paths, DispatchPattern=equals.Equality)  # -> ListA, ListB
branch = TreeBranch(Tree=relay_2, Path=dispatch.ListB, MaintainPaths=True)
tstat_2 = TreeStatistics(Tree=branch)  # -> Paths, Length, Count
equals_2 = Equality(FirstNumber=tstat_2.Length, SecondNumber=4)  # -> Equality, Inequality
dispatch_2 = Dispatch(List=tstat_2.Paths, DispatchPattern=equals_2.Equality)  # -> ListA, ListB
branch_2 = TreeBranch(Tree=relay, Path=dispatch.ListA, MaintainPaths=True)
branch_3 = TreeBranch(Tree=relay_2, Path=dispatch.ListA, MaintainPaths=True)
branch_4 = TreeBranch(Tree=branch, Path=dispatch_2.ListA, MaintainPaths=True)
branch_5 = TreeBranch(Tree=branch, Path=dispatch_2.ListB, MaintainPaths=True)
branch_6 = TreeBranch(Tree=relay, Path=dispatch_2.ListA, MaintainPaths=True)
move = Move(Geometry=branch_4, Motion=branch_6)  # -> Geometry, Transform
move_2 = Move(Geometry=branch_3, Motion=branch_2)  # -> Geometry, Transform
merge = Merge(Data1=move_2.Geometry, Data2=move.Geometry, Data3=branch_5)
clean = CleanTree(RemoveNulls=True, RemoveInvalid=True, RemoveEmpty=False, Tree=merge)
T = ClusterOutput(clean)

# ==== cluster Cluster_2
relay = ClusterInput()
index = ItemIndex(List=relay, Item=relay)
equals = Equality(FirstNumber=index, SecondNumber=1)  # -> Equality, Inequality
equals_2 = Equality(FirstNumber=index, SecondNumber=2)  # -> Equality, Inequality
equals_3 = Equality(FirstNumber=index, SecondNumber=3)  # -> Equality, Inequality
dispatch = Dispatch(List=index, DispatchPattern=equals.Equality)  # -> ListA, ListB
dispatch_2 = Dispatch(List=index, DispatchPattern=equals_2.Equality)  # -> ListA, ListB
dispatch_3 = Dispatch(List=index, DispatchPattern=equals_3.Equality)  # -> ListA, ListB
item = ListItem(List=relay, Index=dispatch_2.ListA, Wrap=True)
item_2 = ListItem(List=relay, Index=dispatch_3.ListA, Wrap=True)
item_3 = ListItem(List=relay, Index=dispatch.ListA, Wrap=True)
item_4 = ListItem(List=relay, Index=0, Wrap=True)
C = ClusterInput()
end = EndPoints(Curve=item_4)  # -> Start, End
end_2 = EndPoints(Curve=C)  # -> Start, End
vec2pt = Vector2Pt(PointA=end.Start, PointB=end_2.Start, Unitize=False)  # -> Vector, Length
A = ClusterInput()
amp = Amplitude(Vector=vec2pt.Vector, Amplitude=A)
rev = Reverse(Vector=amp)
V = ClusterOutput(rev)
move = Move(Geometry=item_2, Motion=expr("x*4", amp))  # -> Geometry, Transform
move_2 = Move(Geometry=item_3, Motion=expr("x*2", amp))  # -> Geometry, Transform
move_3 = Move(Geometry=item, Motion=expr("x*2", rev))  # -> Geometry, Transform
merge = Merge(Data1=item_4, Data2=move_2.Geometry, Data3=move_3.Geometry, Data4=move.Geometry)
clean = CleanTree(RemoveNulls=True, RemoveInvalid=True, RemoveEmpty=False, Tree=merge)
T = ClusterOutput(clean)

# ==== cluster Cluster_3
relay = ClusterInput()
relay_2 = ClusterInput()
relay_3 = ClusterInput()

cp = ControlPoints(Curve=relay)  # -> Points, Weights, Knots
area = Area(Geometry=relay)  # -> Area, Centroid
ln = Line(StartPoint=area.Centroid, EndPoint=cp.Points)
crossref = CrossReference(ListA=ln, ListB=ln, CrossMode=5)  # -> graft(ListA), graft(ListB)
end = EndPoints(Curve=ln)  # -> Start, End
geo = Geometry([crossref.ListA, crossref.ListB])
join = JoinCurves(Curves=geo, Preserve=False)  # -> simplify(Curves)
number_slider = Slider(10, range=0..10)
trim = TrimTree(Tree=join, Depth=1)
scale = Scale(Geometry=trim, Center=end.Start, Factor=1.5)  # -> Geometry, Transform
neg = Negative(Value=number_slider)
clean = CleanTree(RemoveNulls=True, RemoveInvalid=True, RemoveEmpty=False, Tree=scale.Geometry)
rev = Reverse(Vector=relay)
rot3d = Rotate3D(Geometry=clean, Angle=degrees(neg), Center=area.Centroid, Axis=relay)  # -> Geometry, Transform
rot3d_2 = Rotate3D(Geometry=clean, Angle=degrees(number_slider), Center=area.Centroid, Axis=relay)  # -> Geometry, Transform
move = Move(Geometry=rot3d_2.Geometry, Motion=relay_3)  # -> Geometry, Transform
move_2 = Move(Geometry=rot3d.Geometry, Motion=relay_3)  # -> Geometry, Transform
extr = Extrude(Base=move.Geometry, Direction=expr("2*x", relay_2))
extr_2 = Extrude(Base=move_2.Geometry, Direction=expr("2*x", relay_2))

E = ClusterOutput(extr)
E_2 = ClusterOutput(extr_2)

# ==== cluster Cluster_4
relay = ClusterInput()
relay_2 = ClusterInput()
tstat = TreeStatistics(Tree=relay_2)  # -> Paths, Length, Count
equals = Equality(FirstNumber=tstat.Length, SecondNumber=2)  # -> Equality, Inequality
dispatch = Dispatch(List=tstat.Paths, DispatchPattern=equals.Equality)  # -> ListA, ListB
branch = TreeBranch(Tree=relay_2, Path=dispatch.ListB, MaintainPaths=True)
tstat_2 = TreeStatistics(Tree=branch)  # -> Paths, Length, Count
equals_2 = Equality(FirstNumber=tstat_2.Length, SecondNumber=4)  # -> Equality, Inequality
dispatch_2 = Dispatch(List=tstat_2.Paths, DispatchPattern=equals_2.Equality)  # -> ListA, ListB
branch_2 = TreeBranch(Tree=relay_2, Path=dispatch.ListA, MaintainPaths=True)
branch_3 = TreeBranch(Tree=relay, Path=dispatch.ListA, MaintainPaths=True)
branch_4 = TreeBranch(Tree=branch, Path=dispatch_2.ListA, MaintainPaths=True)
branch_5 = TreeBranch(Tree=branch, Path=dispatch_2.ListB, MaintainPaths=True)
branch_6 = TreeBranch(Tree=relay, Path=dispatch_2.ListA, MaintainPaths=True)
move = Move(Geometry=branch_2, Motion=branch_3)  # -> Geometry, Transform
move_2 = Move(Geometry=branch_4, Motion=branch_6)  # -> Geometry, Transform
merge = Merge(Data1=move.Geometry, Data2=move_2.Geometry, Data3=branch_5)
clean = CleanTree(RemoveNulls=True, RemoveInvalid=True, RemoveEmpty=False, Tree=merge)
T = ClusterOutput(clean)
